# Grasshopper definition stick04.gh (Grasshopper 1.0.7)
# plug-ins: treesloth01, Kangaroo2 Components, Weaverbird, ShapeDiverForGrasshopper, MeshEdit Components, Pufferfish

sddp = ShapeDiverDocumentPayload({AbsoluteTolerance=0, AngleTolerance=0, DistanceDisplayPrecision=0, GltfVersion="Gltf2", GrasshopperVersion="1.0.0007", InputGroups="{}", OutputGroups="{}", RelativeTolerance=0, RhinoVersion="7.33.23248.13001", UnitSystem=0, VersionCreated="1.15.0.0", VersionSaved="1.15.0.0"})
curve = Curve(<curve referenced from the Rhino model>)
divide_curve = DivideCurve(Curve=curve, Count=Slider(100, range=0..100), Kinks=False)  # -> Points, Tangents, Parameters
interpolate = Interpolate(Vertices=divide_curve.Points, Degree=3, Periodic=False, KnotStyle=1)  # -> Curve, Length, Domain
length = Length(Curve=interpolate.Curve)

# ----
# Create Main Branch
length_cm = Slider(53, range=20..100)
length_2 = GetNumber(length_cm, AtLeast=1, AtMost=1, Maximum=1.797693135e+308, Minimum=-1.797693135e+308, TreeAccess=False)
construct_point = ConstructPoint(XCoordinate=0, YCoordinate=0, ZCoordinate=0)
unit_x = UnitX(Factor=1)
number_slider = Slider(25, range=0..100)
number_slider_2 = Slider(70, range=0..100)
division = Division(A=length_2, B=100)
initial_branch_gnarliness = Slider(70, range=25..70)
line_sdl = LineSDL(Start=construct_point, Direction=unit_x, Length=division)
branch_interest = Slider(10, range=6..12)
construct_domain = ConstructDomain(DomainStart=number_slider, DomainEnd=number_slider_2)
construct_domain_2 = ConstructDomain(DomainStart=number_slider_2, DomainEnd=number_slider)
gnar = GetInteger(initial_branch_gnarliness, AtLeast=1, AtMost=1, Maximum=2147483647, Minimum=-2147483648, TreeAccess=False)
interest = GetInteger(branch_interest, AtLeast=1, AtMost=1, Maximum=2147483647, Minimum=-2147483648, TreeAccess=False)
birth_month = Slider(3, range=1..12)
birth_day = Slider(12, range=1..31)
remap_numbers = RemapNumbers(Value=gnar, Source=construct_domain, Target=construct_domain_2)  # -> Mapped, Clipped
divide_curve_2 = DivideCurve(Curve=line_sdl, Count=interest, Kinks=False)  # -> Points, Tangents, Parameters
length_3 = Length(Curve=line_sdl)
month = GetInteger(birth_month, AtLeast=1, AtMost=1, Maximum=2147483647, Minimum=-2147483648, TreeAccess=False)
day = GetInteger(birth_day, AtLeast=1, AtMost=1, Maximum=2147483647, Minimum=-2147483648, TreeAccess=False)
construct_date = ConstructDate(Year=2024, Month=month, Day=day, Hour=12, Minute=0, Second=0)
list_length = ListLength(List=divide_curve_2.Points)
division_2 = Division(A=length_3, B=remap_numbers.Mapped)
construct_domain_3 = ConstructDomain(DomainStart=0, DomainEnd=division_2)
random = Random(Range=construct_domain_3, Number=list_length, Seed=month)
random_2 = Random(Range=construct_domain_3, Number=list_length, Seed=day)
vector_xyz = VectorXYZ(XComponent=0, YComponent=random, ZComponent=random_2)  # -> Vector, Length
number_slider_3 = Slider(1, range=0..1)
move = Move(Geometry=divide_curve_2.Points, Motion=vector_xyz.Vector)  # -> Geometry, Transform
interpolate_2 = Interpolate(Vertices=move.Geometry, Degree=Slider(3, range=0..10), Periodic=False, KnotStyle=1)  # -> Curve, Length, Domain

point = Point(Point(0.43070627, -0.05386731982, -0.03319044264))

# ----
# Create Twigs
number_slider_4 = Slider(9.4, range=5..12)
panel = Panel("""0
-1""")
cull_index = CullIndex(List=move.Geometry, Indices=panel, Wrap=True)
division_3 = Division(A=division, B=number_slider_4)
list_length_2 = ListLength(List=cull_index)
list_item = ListItem(List=move.Geometry, Index="-1", Wrap=True)
construct_domain_4 = ConstructDomain(DomainStart=Slider(0, range=0..0.1), DomainEnd=division_3)
subtraction = Subtraction(A=list_length_2, B=1)
range = Range(Domain=construct_domain_4, Steps=subtraction)
move_away_from = MoveAwayFrom(Geometry=cull_index, Emitter=interpolate_2.Curve, Distance=range)  # -> Geometry, Transform
move_away_from_2 = MoveAwayFrom(Geometry=move_away_from.Geometry, Emitter=point, Distance=range)  # -> Geometry, Transform
line = Line(StartPoint=cull_index, EndPoint=move_away_from_2.Geometry)
clean_tree = CleanTree(RemoveNulls=True, RemoveInvalid=True, RemoveEmpty=False, Tree=line)
length_4 = Length(Curve=clean_tree)
divide_curve_3 = DivideCurve(Curve=clean_tree, Count=Slider(4, range=0..10), Kinks=False)  # -> Points, Tangents, Parameters
division_4 = Division(A=length_4, B=Slider(10, range=10..100))
construct_domain_5 = ConstructDomain(DomainStart=0, DomainEnd=division_4)
panel_2 = Panel("""0
-1""")
panel_3 = Panel("""0
-1""")
cull_index_2 = CullIndex(List=divide_curve_3.Points, Indices=panel_2, Wrap=True)  # -> simplify(List)
list_length_3 = ListLength(List=cull_index_2)
list_item_2 = ListItem(List=simplify(divide_curve_3.Points), Index=panel_3, Wrap=True)
random_3 = Random(Range=simplify(graft(construct_domain_5)), Number=list_length_3, Seed=month)
random_4 = Random(Range=simplify(graft(construct_domain_5)), Number=list_length_3, Seed=day)
first_last = FirstLast(List=list_item_2)  # -> FirstValue, LastValue
vector_xyz_2 = VectorXYZ(XComponent=0, YComponent=random_3, ZComponent=random_4)  # -> Vector, Length
move_2 = Move(Geometry=cull_index_2, Motion=vector_xyz_2.Vector)  # -> simplify(Geometry), Transform
merge = Merge(Data1=first_last.FirstValue, Data2=move_2.Geometry, Data3=first_last.LastValue)
interpolate_3 = Interpolate(Vertices=merge, Degree=Slider(1, range=0..10), Periodic=False, KnotStyle=1)  # -> flatten(Curve), Length, Domain

colour_swatch = ColourSwatch(SwatchColor=RGB(102, 65, 38))  # disabled

# ----
# Node Sizes and Values to Taper
branch_max_thickness_mm = Slider(5.7, range=2..10)
branch_min_thickness = Slider(1, range=1..2)
thickness = GetNumber(branch_max_thickness_mm, AtLeast=1, AtMost=1, Maximum=1.797693135e+308, Minimum=-1.797693135e+308, TreeAccess=False)
division_5 = Division(A=thickness, B=1000)
data = Data(flatten(move.Geometry))
list_length_4 = ListLength(List=data)
data_2 = Data(flatten(first_last.LastValue))
list_length_5 = ListLength(List=data_2)
division_6 = Division(A=division_5, B=Slider(3, range=0..10))
subtraction_2 = Subtraction(A=list_length_4, B=1)
repeat_data = RepeatData(Data=division_6, Length=list_length_5)
entwine = Entwine(Branch00=move.Geometry, Branch01=data_2, FlattenInputs=True)  # -> flatten(Result)

division_7 = Division(A=branch_min_thickness, B=1000)

construct_domain_6 = ConstructDomain(DomainStart=division_7, DomainEnd=division_5)
range_2 = Range(Domain=construct_domain_6, Steps=subtraction_2)
entwine_2 = Entwine(Branch00=range_2, Branch01=repeat_data, FlattenInputs=True)  # -> flatten(Result)

# ----
# SubD Pipe and Mesh
number_slider_5 = Slider(0.1, range=0..1)
join_curves = JoinCurves(Curves=[interpolate_2.Curve, interpolate_3.Curve], Preserve=False)  # -> flatten(Curves)
multipipe = MultiPipe(
    Curves=join_curves,
    NodeSize=entwine_2,
    SizePoints=entwine,
    EndOffset=1,
    StrutSize=1,
    Segment=0,
    KinkAngle=number_slider_5,
    CubeFit=0,
    Caps=Slider(1, range=0..10))
mesh_from_subd = MeshFromSubD(SubD=multipipe, Density=2)
weaverbird_s_join_meshes_and_weld = WeaverbirdsJoinMeshesAndWeld(Mesh=mesh_from_subd, Weld=False)

cm3 = Slider(0.25, range=0..1)
mesh_volume = MeshVolume(Mesh=mesh_from_subd)  # -> Volume, Centroid
multiplication = Multiplication(A=mesh_volume.Volume, B=Slider(1000000, range=0..1000000))
multiplication_2 = Multiplication(A=multiplication, B=cm3)
round_to_decimal_place = RoundToDecimalPlace(NumberX=multiplication_2, DecimalPlace="2", RoundType=0)  # -> Rounded, Difference
round_to_decimal_place_2 = RoundToDecimalPlace(NumberX=multiplication, DecimalPlace="2", RoundType=0)  # -> Rounded, Difference
volume_cm3 = Panel(round_to_decimal_place_2.Rounded)
price = Panel(round_to_decimal_place.Rounded)

context_bake = ContextBake(Geometry=weaverbird_s_join_meshes_and_weld)
custom_preview = CustomPreview(Geometry=weaverbird_s_join_meshes_and_weld, Material=colour_swatch)  # disabled
context_print = ContextPrint(Volume=round_to_decimal_place_2.Rounded)
context_print_2 = ContextPrint(Price=round_to_decimal_place.Rounded)
