# Grasshopper definition stick06.gh (Grasshopper 1.0.7)
# plug-ins: treesloth01, Kangaroo2 Components, Weaverbird, ShapeDiverForGrasshopper, MeshEdit Components, Pufferfish

sddp = ShapeDiverDocumentPayload({AbsoluteTolerance=0, AngleTolerance=0, DistanceDisplayPrecision=0, GltfVersion="Gltf2", GrasshopperVersion="1.0.0007", InputGroups="{}", OutputGroups="{}", RelativeTolerance=0, RhinoVersion="7.33.23248.13001", UnitSystem=0, VersionCreated="1.15.0.0", VersionSaved="1.15.0.0"})
length_medium_cm = Slider(50, range=20..100)
length_long_cm = Slider(100, range=20..100)
# rhino input first
# then they press the toogle ON to use standard
panel = Panel("100")
division = Division(A=length_long_cm, B=100)
division_2 = Division(A=length_medium_cm, B=100)
point = Point(Point(0.3436088702, -0.002259912013, -0.002258488264))

# ----
# Create Main Branch
value_list = ValueList({"Standard Short": 0, "Standard Medium": 1, "Standard Long": 2, "Custom": 3}, selected="Standard Medium")
length_short_cm = Slider(25, range=20..100)
curve = Curve(<curve referenced from the Rhino model>)
construct_point = ConstructPoint(XCoordinate=0, YCoordinate=0, ZCoordinate=0)
unit_x = UnitX(Factor=1)
division_3 = Division(A=length_short_cm, B=100)
line_sdl = LineSDL(Start=construct_point, Direction=unit_x, Length=division_3)
number_slider = Slider(25, range=0..100)
number_slider_2 = Slider(70, range=0..100)
gnarliness_interest = Slider(11, range=6..15)
initial_branch_gnarliness = Slider(70, range=25..70)
construct_domain = ConstructDomain(DomainStart=number_slider, DomainEnd=number_slider_2)
construct_domain_2 = ConstructDomain(DomainStart=number_slider_2, DomainEnd=number_slider)
interest = GetInteger(gnarliness_interest, AtLeast=1, AtMost=1, Maximum=2147483647, Minimum=-2147483648, TreeAccess=False)
birth_month = Slider(4, range=1..12)
birth_day = Slider(12, range=1..31)
remap_numbers = RemapNumbers(Value=initial_branch_gnarliness, Source=construct_domain, Target=construct_domain_2)  # -> Mapped, Clipped
month = GetInteger(birth_month, AtLeast=1, AtMost=1, Maximum=2147483647, Minimum=-2147483648, TreeAccess=False)
day = GetInteger(birth_day, AtLeast=1, AtMost=1, Maximum=2147483647, Minimum=-2147483648, TreeAccess=False)
# slider for drop downs
# front end UI for month language
construct_date = ConstructDate(Year=2024, Month=month, Day=day, Hour=12, Minute=0, Second=0)

divide_curve = DivideCurve(Curve=curve, Count=panel, Kinks=False)  # -> Points, Tangents, Parameters
get_integer = GetInteger(value_list, AtLeast=1, AtMost=1, Maximum=2147483647, Minimum=-2147483648, TreeAccess=False)
interpolate = Interpolate(Vertices=divide_curve.Points, Degree=3, Periodic=False, KnotStyle=1)  # -> Curve, Length, Domain
line_sdl_2 = LineSDL(Start=construct_point, Direction=unit_x, Length=division)
line_sdl_3 = LineSDL(Start=construct_point, Direction=unit_x, Length=division_2)
stream_filter = StreamFilter(Gate=get_integer, Stream0=line_sdl, Stream1=line_sdl_3, Stream2=line_sdl_2, Stream3=interpolate.Curve)

divide_curve_2 = DivideCurve(Curve=stream_filter, Count=interest, Kinks=False)  # -> Points, Tangents, Parameters
length = Length(Curve=stream_filter)
list_length = ListLength(List=divide_curve_2.Points)
division_4 = Division(A=length, B=remap_numbers.Mapped)
construct_domain_3 = ConstructDomain(DomainStart=0, DomainEnd=division_4)
random = Random(Range=construct_domain_3, Number=list_length, Seed=month)
random_2 = Random(Range=construct_domain_3, Number=list_length, Seed=day)
vector_xyz = VectorXYZ(XComponent=0, YComponent=random, ZComponent=random_2)  # -> Vector, Length
move = Move(Geometry=divide_curve_2.Points, Motion=vector_xyz.Vector)  # -> Geometry, Transform
interpolate_2 = Interpolate(Vertices=move.Geometry, Degree=Slider(3, range=0..10), Periodic=False, KnotStyle=1)  # -> Curve, Length, Domain

# ----
# Filter Gnarliness
number_slider_3 = Slider(5, range=0..10)
number_slider_4 = Slider(7, range=0..100)
number_slider_5 = Slider(9, range=0..100)
number_slider_6 = Slider(11, range=0..100)
number_slider_7 = Slider(13, range=0..100)
larger_than = LargerThan(FirstNumber=interest, SecondNumber=number_slider_3)  # -> LargerThan, OrEqualTo
smaller_than = SmallerThan(FirstNumber=interest, SecondNumber=number_slider_4)  # -> SmallerThan, OrEqualTo
smaller_than_2 = SmallerThan(FirstNumber=interest, SecondNumber=number_slider_5)  # -> SmallerThan, OrEqualTo
larger_than_2 = LargerThan(FirstNumber=interest, SecondNumber=number_slider_4)  # -> LargerThan, OrEqualTo
smaller_than_3 = SmallerThan(FirstNumber=interest, SecondNumber=number_slider_6)  # -> SmallerThan, OrEqualTo
larger_than_3 = LargerThan(FirstNumber=interest, SecondNumber=number_slider_5)  # -> LargerThan, OrEqualTo
smaller_than_4 = SmallerThan(FirstNumber=interest, SecondNumber=number_slider_7)  # -> SmallerThan, OrEqualTo
larger_than_4 = LargerThan(FirstNumber=interest, SecondNumber=number_slider_6)  # -> LargerThan, OrEqualTo
larger_than_5 = LargerThan(FirstNumber=interest, SecondNumber=number_slider_7)  # -> LargerThan, OrEqualTo
gate_and = GateAnd(A=larger_than.OrEqualTo, B=smaller_than.OrEqualTo)
gate_and_2 = GateAnd(A=larger_than_2.LargerThan, B=smaller_than_2.OrEqualTo)
gate_and_3 = GateAnd(A=larger_than_3.LargerThan, B=smaller_than_3.OrEqualTo)
gate_and_4 = GateAnd(A=larger_than_4.LargerThan, B=smaller_than_4.OrEqualTo)
panel_2 = Panel(gate_and)
panel_3 = Panel(gate_and_2)
panel_4 = Panel(gate_and_3)
panel_5 = Panel(gate_and_4)
panel_6 = Panel(larger_than_5.LargerThan)

# ----
# Display stick length
panel_7 = Panel("0")
stream_filter_2 = StreamFilter(Gate=get_integer, Stream0=line_sdl, Stream1=line_sdl_3, Stream2=line_sdl_2, Stream3=interpolate.Curve)
list_item = ListItem(List=move.Geometry, Index="-1", Wrap=True)
list_item_2 = ListItem(List=move.Geometry, Index=panel_7, Wrap=True)
length_2 = Length(Curve=stream_filter_2)
line = Line(StartPoint=list_item_2, EndPoint=list_item)
round_to_decimal_place = RoundToDecimalPlace(NumberX=length_2, DecimalPlace="2", RoundType=0)  # -> Rounded, Difference
stream_filter_3 = StreamFilter(Gate=get_integer, Stream0=line, Stream1=line, Stream2=line, Stream3=interpolate.Curve)
multiplication = Multiplication(A=round_to_decimal_place.Rounded, B=100)
number_slider_8 = Slider(0.03, range=0..0.1)
unit_z = UnitZ(Factor=number_slider_8)
unit_z_2 = UnitZ(Factor=number_slider_8)
text = Text(multiplication)
move_2 = Move(Geometry=stream_filter_3, Motion=unit_z_2)  # -> Geometry, Transform
extrude = Extrude(Base=move_2.Geometry, Direction=unit_z)
number_slider_9 = Slider(0.01, range=0..0.1)
unit_z_3 = UnitZ(Factor=number_slider_9)
flip = Flip(Surface=extrude)  # -> Surface, Result
concatenate = Concatenate(FragmentA=text, FragmentB=" cm")
move_3 = Move(Geometry=move_2.Geometry, Motion=unit_z_3)  # -> Geometry, Transform
text_on_surface = TextOnSurface(
    Text=concatenate,
    Font="Sans Bold:no Italic:no",
    Height=number_slider_9,
    Depth=Slider(0.0001, range=0..0.0001),
    BaseLine=move_3.Geometry,
    BaseSurface=flip.Surface)
multipipe = MultiPipe(
    Curves=move_2.Geometry,
    NodeSize=Slider(0.0001, range=0..0.0001),
    EndOffset=1,
    StrutSize=1,
    Segment=0,
    KinkAngle=0.6,
    CubeFit=0,
    Caps=0)
brep_join = BrepJoin(Breps=text_on_surface)  # -> Breps, Closed

# ----
# Suggest Danger Level
panel_8 = Panel("""No stress
Low danger
Keep an eye on it
Watch out
Call the paint shop""")
merge = Merge(Data1=gate_and, Data2=gate_and_2, Data3=gate_and_3, Data4=gate_and_4, Data5=larger_than_5.LargerThan)
cull_pattern = CullPattern(List=panel_8, CullPattern=merge)
concatenate_2 = Concatenate(FragmentA="Level of car scratch and damage potential: ", FragmentB=cull_pattern)
panel_9 = Panel(concatenate_2)

# ----
# Create Twigs
twig_length_cm = Slider(4.3, range=1..10)
panel_10 = Panel("""0
-1""")
cull_index = CullIndex(List=move.Geometry, Indices=panel_10, Wrap=True)
list_length_2 = ListLength(List=cull_index)
subtraction = Subtraction(A=list_length_2, B=1)
panel_11 = Panel("""0
-1""")
panel_12 = Panel("""0
-1""")

get_number = GetNumber(twig_length_cm, AtLeast=1, AtMost=1, Maximum=1.797693135e+308, Minimum=-1.797693135e+308, TreeAccess=False)
division_5 = Division(A=get_number, B=100)

construct_domain_4 = ConstructDomain(DomainStart=Slider(0, range=0..0.1), DomainEnd=division_5)
range = Range(Domain=construct_domain_4, Steps=subtraction)
move_away_from = MoveAwayFrom(Geometry=cull_index, Emitter=interpolate_2.Curve, Distance=range)  # -> Geometry, Transform
move_away_from_2 = MoveAwayFrom(Geometry=move_away_from.Geometry, Emitter=point, Distance=range)  # -> Geometry, Transform
line_2 = Line(StartPoint=cull_index, EndPoint=move_away_from_2.Geometry)
clean_tree = CleanTree(RemoveNulls=True, RemoveInvalid=True, RemoveEmpty=False, Tree=line_2)
length_3 = Length(Curve=clean_tree)
divide_curve_3 = DivideCurve(Curve=clean_tree, Count=Slider(5, range=0..10), Kinks=False)  # -> Points, Tangents, Parameters
division_6 = Division(A=length_3, B=Slider(10, range=10..100))
construct_domain_5 = ConstructDomain(DomainStart=0, DomainEnd=division_6)
cull_index_2 = CullIndex(List=divide_curve_3.Points, Indices=panel_11, Wrap=True)  # -> simplify(List)
list_length_3 = ListLength(List=cull_index_2)
list_item_3 = ListItem(List=simplify(divide_curve_3.Points), Index=panel_12, Wrap=True)
random_3 = Random(Range=simplify(graft(construct_domain_5)), Number=list_length_3, Seed=month)
random_4 = Random(Range=simplify(graft(construct_domain_5)), Number=list_length_3, Seed=day)
first_last = FirstLast(List=list_item_3)  # -> FirstValue, LastValue
vector_xyz_2 = VectorXYZ(XComponent=0, YComponent=random_3, ZComponent=random_4)  # -> Vector, Length
move_4 = Move(Geometry=cull_index_2, Motion=vector_xyz_2.Vector)  # -> simplify(Geometry), Transform
merge_2 = Merge(Data1=first_last.FirstValue, Data2=move_4.Geometry, Data3=first_last.LastValue)
interpolate_3 = Interpolate(Vertices=merge_2, Degree=Slider(1, range=0..10), Periodic=False, KnotStyle=1)  # -> flatten(Curve), Length, Domain

reverse_list = ReverseList(List=move_away_from_2.Geometry)

# ----
# Node Sizes and Values to Taper
branch_min_thickness = Slider(1, range=1..2)
branch_max_thickness_mm = Slider(3.7, range=2..10)
thickness = GetNumber(branch_max_thickness_mm, AtLeast=1, AtMost=1, Maximum=1.797693135e+308, Minimum=-1.797693135e+308, TreeAccess=False)
division_7 = Division(A=thickness, B=1000)
data = Data(flatten(move.Geometry))
list_length_4 = ListLength(List=data)
data_2 = Data(flatten(first_last.LastValue))
subtraction_2 = Subtraction(A=list_length_4, B=1)
list_length_5 = ListLength(List=data_2)
division_8 = Division(A=division_7, B=Slider(3, range=0..10))
repeat_data = RepeatData(Data=division_8, Length=list_length_5)
entwine = Entwine(Branch00=move.Geometry, Branch01=data_2, FlattenInputs=True)  # -> flatten(Result)

division_9 = Division(A=branch_min_thickness, B=1000)

construct_domain_6 = ConstructDomain(DomainStart=division_9, DomainEnd=division_7)
range_2 = Range(Domain=construct_domain_6, Steps=subtraction_2)
entwine_2 = Entwine(Branch00=range_2, Branch01=repeat_data, FlattenInputs=True)  # -> flatten(Result)

# ----
# SubD Pipe and Mesh
number_slider_10 = Slider(0.1, range=0..1)
join_curves = JoinCurves(Curves=[interpolate_2.Curve, interpolate_3.Curve], Preserve=False)  # -> flatten(Curves)
multipipe_2 = MultiPipe(
    Curves=join_curves,
    NodeSize=entwine_2,
    SizePoints=entwine,
    EndOffset=1,
    StrutSize=1,
    Segment=0,
    KinkAngle=number_slider_10,
    CubeFit=0,
    Caps=Slider(1, range=0..10))
mesh_from_subd = MeshFromSubD(SubD=multipipe_2, Density=2)
weaverbird_s_join_meshes_and_weld = WeaverbirdsJoinMeshesAndWeld(Mesh=mesh_from_subd, Weld=False)

# ----
# Extract Data
cm3 = Slider(0.25, range=0..1)
mesh_volume = MeshVolume(Mesh=mesh_from_subd)  # -> Volume, Centroid
multiplication_2 = Multiplication(A=mesh_volume.Volume, B=Slider(1000000, range=0..1000000))
multiplication_3 = Multiplication(A=multiplication_2, B=cm3)
round_to_decimal_place_2 = RoundToDecimalPlace(NumberX=multiplication_3, DecimalPlace="2", RoundType=0)  # -> Rounded, Difference
round_to_decimal_place_3 = RoundToDecimalPlace(NumberX=multiplication_2, DecimalPlace="2", RoundType=0)  # -> Rounded, Difference
volume_cm3 = Panel(round_to_decimal_place_3.Rounded)
price = Panel(round_to_decimal_place_2.Rounded)

# ----
# Filter Volume
number_slider_11 = Slider(0, range=0..10)
number_slider_12 = Slider(5, range=0..100)
number_slider_13 = Slider(10, range=0..100)
number_slider_14 = Slider(20, range=0..100)
number_slider_15 = Slider(30, range=0..100)
larger_than_6 = LargerThan(FirstNumber=round_to_decimal_place_3.Rounded, SecondNumber=number_slider_11)  # -> LargerThan, OrEqualTo
smaller_than_5 = SmallerThan(FirstNumber=round_to_decimal_place_3.Rounded, SecondNumber=number_slider_12)  # -> SmallerThan, OrEqualTo
smaller_than_6 = SmallerThan(FirstNumber=round_to_decimal_place_3.Rounded, SecondNumber=number_slider_13)  # -> SmallerThan, OrEqualTo
larger_than_7 = LargerThan(FirstNumber=round_to_decimal_place_3.Rounded, SecondNumber=number_slider_12)  # -> LargerThan, OrEqualTo
smaller_than_7 = SmallerThan(FirstNumber=round_to_decimal_place_3.Rounded, SecondNumber=number_slider_14)  # -> SmallerThan, OrEqualTo
larger_than_8 = LargerThan(FirstNumber=round_to_decimal_place_3.Rounded, SecondNumber=number_slider_13)  # -> LargerThan, OrEqualTo
smaller_than_8 = SmallerThan(FirstNumber=round_to_decimal_place_3.Rounded, SecondNumber=number_slider_15)  # -> SmallerThan, OrEqualTo
larger_than_9 = LargerThan(FirstNumber=round_to_decimal_place_3.Rounded, SecondNumber=number_slider_14)  # -> LargerThan, OrEqualTo
larger_than_10 = LargerThan(FirstNumber=round_to_decimal_place_3.Rounded, SecondNumber=number_slider_15)  # -> LargerThan, OrEqualTo
gate_and_5 = GateAnd(A=larger_than_6.OrEqualTo, B=smaller_than_5.OrEqualTo)
gate_and_6 = GateAnd(A=larger_than_7.LargerThan, B=smaller_than_6.OrEqualTo)
gate_and_7 = GateAnd(A=larger_than_8.LargerThan, B=smaller_than_7.OrEqualTo)
gate_and_8 = GateAnd(A=larger_than_9.LargerThan, B=smaller_than_8.OrEqualTo)
panel_13 = Panel(gate_and_5)
panel_14 = Panel(gate_and_6)
panel_15 = Panel(gate_and_7)
panel_16 = Panel(gate_and_8)
panel_17 = Panel(larger_than_10.LargerThan)

# ----
# Suggest Bred and Color Mesh
panel_18 = Panel("""Yorkies, Chihuahuas, Maltese, Pug, Boston Terrier, French Bulldog, and similiar
Baegles, Scottish Terriers, Minature Schnauzers, and similar
Boxer, Bull Dog, Australian Shepherds, Cocker Spaniels, and similar
Labrador Retrievers, German Shepards, Standard Poodles, Border Collie, and similar
Bernese Mountain Dog, Great Dane, St Bernard, and similar""")
merge_3 = Merge(Data1=gate_and_5, Data2=gate_and_6, Data3=gate_and_7, Data4=gate_and_8, Data5=larger_than_10.LargerThan)
merge_4 = Merge(
    Data1=ColourSwatch(SwatchColor=RGB(187, 0, 255)),
    Data2=ColourSwatch(SwatchColor=RGB(0, 255, 183)),
    Data3=ColourSwatch(SwatchColor=RGB(255, 229, 0)),
    Data4=ColourSwatch(SwatchColor=RGB(255, 162, 0)),
    Data5=ColourSwatch(SwatchColor=RGB(255, 30, 0)))
cull_pattern_2 = CullPattern(List=panel_18, CullPattern=merge_3)
cull_pattern_3 = CullPattern(List=merge_4, CullPattern=merge_3)
concatenate_3 = Concatenate(FragmentA="Ideal for breeds like ", FragmentB=cull_pattern_2)
panel_19 = Panel(concatenate_3)
custom_preview = CustomPreview(Geometry=weaverbird_s_join_meshes_and_weld, Material=cull_pattern_3)

mesh_colours = MeshColours(Mesh=weaverbird_s_join_meshes_and_weld, Colours=cull_pattern_3)

context_bake = ContextBake(Geometry=multipipe)  # disabled
context_bake_2 = ContextBake(Geometry=brep_join.Breps)  # disabled
context_print = ContextPrint(Volume=round_to_decimal_place_3.Rounded)  # disabled
context_print_2 = ContextPrint(Danger=concatenate_2)  # disabled
context_bake_3 = ContextBake(Geometry=mesh_colours)
context_print_3 = ContextPrint(Price=round_to_decimal_place_2.Rounded)  # disabled
context_print_4 = ContextPrint(Text=concatenate_3)  # disabled
