# Grasshopper definition stick07.gh (Grasshopper 1.0.7)
# plug-ins: treesloth01, Kangaroo2 Components, Weaverbird, ShapeDiverForGrasshopper, MeshEdit Components, Pufferfish

sddp = ShapeDiverDocumentPayload({AbsoluteTolerance=0, AngleTolerance=0, DistanceDisplayPrecision=0, GltfVersion="Gltf2", GrasshopperVersion="1.0.0007", InputGroups="{}", OutputGroups="{}", RelativeTolerance=0, RhinoVersion="7.33.23248.13001", UnitSystem=0, VersionCreated="1.15.0.0", VersionSaved="1.15.0.0"})
length_medium_cm = Slider(50, range=20..100)
length_long_cm = Slider(100, range=20..100)
encodedfile = GetString(AtLeast=1, AtMost=1, TreeAccess=False)
path = FilePath("C:\Users\rswart\OneDrive - SmithGroup Companies Inc\IAAC\BIMSC\Data Management\DM_final\base.3dm")
division = Division(A=length_long_cm, B=100)
division_2 = Division(A=length_medium_cm, B=100)
python = GhPythonScript(data=encodedfile, FP=path)  # -> out, geom, layerIndex, layers, layerColor
# ---------- python: Python ----------
import System
import Rhino

#load Rhino file from string, or from local path
try:
    b64 = System.Convert.FromBase64String(data)
    _dmfile = Rhino.FileIO.File3dm.FromByteArray(b64)
except:
    _dmfile = Rhino.FileIO.File3dm.Read(FP)
    print _dmfile



objtable = _dmfile.Objects
geom = []
geomLayerIndexList = []

#get objects from document
for obj in objtable:
    
    if not isinstance(obj.Geometry,Rhino.Geometry.InstanceReferenceGeometry):
        #get user strings from document and assign to geometry
        for k in obj.Attributes.GetUserStrings().AllKeys:
            value =  obj.Attributes.GetUserString(k)
            obj.Geometry.SetUserString(k, value)
       
        geom.append(obj.Geometry)
        geomLayerIndexList.append(obj.Attributes.LayerIndex)
        

geom_= geom
layerIndex_ = geomLayerIndexList

#get layer information
layers = []
layerColor = []
for l in _dmfile.Layers:
    layerColor.append(l.Color)
    layers.append(l)
    
    
layers_ = layers
layerColor_  = layerColor
# ---------- end python ----------
list = ValueList({"Mesh": 0, "Brep": 1, "SubD": 2, "Curve": 3}, selected="Mesh")
list_2 = ValueList({"Mesh": 0, "Brep": 1, "SubD": 2, "Curve": 3}, selected="Brep")
list_3 = ValueList({"Mesh": 0, "Brep": 1, "SubD": 2, "Curve": 3}, selected="Curve")
type2 = GetString(list_2, AtLeast=1, AtMost=1, TreeAccess=False)
type3 = GetString(list_3, AtLeast=1, AtMost=1, TreeAccess=False)
type = GetString(list, AtLeast=1, AtMost=1, TreeAccess=False)
python_2 = GhPythonScript(type=type2, geo=python.geom)  # -> out, filter_geo, unfiltered; inputs type: Int32, geo: list of GeometryBase
# ---------- python_2: Python ----------
import Rhino.Geometry as rg
import rhinoscriptsyntax as rs

filter_geo= []
unfiltered = []
geo_types = ["Mesh", "Brep", "SubD", "NurbsCurve" ]

for g in geo:
    
    g = rs.coercegeometry(g)
    
    if type(g).__name__ == geo_types[_type]:

        filter_geo.append(g)
    else:
        unfiltered.append(g)
        
filter_geo_ = filter_geo
unfiltered_ = unfiltered
# ---------- end python_2 ----------
python_3 = GhPythonScript(type=type, geo=python.geom)  # -> out, filter_geo, unfiltered; inputs type: Int32, geo: list of GeometryBase; same code as python_2
python_4 = GhPythonScript(type=type3, geo=python.geom)  # -> out, filter_geo, unfiltered; inputs type: Int32, geo: list of GeometryBase
# ---------- python_4: Python ----------
import Rhino.Geometry as rg
import rhinoscriptsyntax as rs

filter_geo= []
unfiltered = []
geo_types = ["Mesh", "Brep", "SubD", "PolylineCurve" ]

for g in geo:
    
    g = rs.coercegeometry(g)
    
    if type(g).__name__ == geo_types[_type]:

        filter_geo.append(g)
    else:
        unfiltered.append(g)
        
filter_geo_ = filter_geo
unfiltered_ = unfiltered
# ---------- end python_4 ----------
clean_tree = CleanTree(RemoveNulls=True, RemoveInvalid=True, RemoveEmpty=False, Tree=python_4.filter_geo)
merge = Merge(Data1=python_3.filter_geo, Data2=python_2.filter_geo)
clean_tree_2 = CleanTree(RemoveNulls=True, RemoveInvalid=True, RemoveEmpty=False, Tree=merge)
brep = Brep(<brep referenced from the Rhino model>)
volume = Volume(Geometry=brep)  # -> Volume, Centroid
point = Point(volume.Centroid)
point_2 = Point(Point(0.410836997, 0.006054352362, -0.002258488264))
emitpoint = GetGeometry(point, AtLeast=1, AtMost=1, DeleteInput=False, Filter=1074004029, TreeAccess=False)

# ----
# Create Main Branch
value = Slider(1, range=0..3)
curve = Curve(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)
length_short_cm = Slider(25, range=20..100)
curve_2 = GetGeometry(curve, AtLeast=1, AtMost=1, DeleteInput=False, Filter=1074004029, TreeAccess=False)
divide_curve = DivideCurve(Curve=curve_2, Count="100", Kinks=False)  # -> Points, Tangents, Parameters
construct_point = ConstructPoint(XCoordinate=0, YCoordinate=0, ZCoordinate=0)
unit_x = UnitX(Factor=1)
division_3 = Division(A=length_short_cm, B=100)
interpolate = Interpolate(Vertices=divide_curve.Points, Degree=3, Periodic=False, KnotStyle=1)  # -> Curve, Length, Domain
line_sdl = LineSDL(Start=construct_point, Direction=unit_x, Length=division_3)
number_slider = Slider(25, range=0..100)
number_slider_2 = Slider(70, range=0..100)
gnarliness_interest = Slider(12, range=6..16)
initial_branch_gnarliness = Slider(70, range=25..70)
construct_domain = ConstructDomain(DomainStart=number_slider, DomainEnd=number_slider_2)
construct_domain_2 = ConstructDomain(DomainStart=number_slider_2, DomainEnd=number_slider)
interest = GetInteger(gnarliness_interest, AtLeast=1, AtMost=1, Maximum=2147483647, Minimum=-2147483648, TreeAccess=False)
birth_month = Slider(4, range=1..12)
birth_day = Slider(14, range=1..31)
remap_numbers = RemapNumbers(Value=initial_branch_gnarliness, Source=construct_domain, Target=construct_domain_2)  # -> Mapped, Clipped
month = GetInteger(birth_month, AtLeast=1, AtMost=1, Maximum=2147483647, Minimum=-2147483648, TreeAccess=False)
day = GetInteger(birth_day, AtLeast=1, AtMost=1, Maximum=2147483647, Minimum=-2147483648, TreeAccess=False)

value_2 = GetInteger(value, AtLeast=1, AtMost=1, Maximum=2147483647, Minimum=-2147483648, TreeAccess=False)
line_sdl_2 = LineSDL(Start=construct_point, Direction=unit_x, Length=division)
line_sdl_3 = LineSDL(Start=construct_point, Direction=unit_x, Length=division_2)
stream_filter = StreamFilter(Gate=value_2, Stream0=line_sdl, Stream1=line_sdl_3, Stream2=line_sdl_2, Stream3=interpolate.Curve)

divide_curve_2 = DivideCurve(Curve=stream_filter, Count=interest, Kinks=False)  # -> Points, Tangents, Parameters
length = Length(Curve=stream_filter)
list_length = ListLength(List=divide_curve_2.Points)
division_4 = Division(A=length, B=remap_numbers.Mapped)
construct_domain_3 = ConstructDomain(DomainStart=0, DomainEnd=division_4)
random = Random(Range=construct_domain_3, Number=list_length, Seed=month)
random_2 = Random(Range=construct_domain_3, Number=list_length, Seed=day)
vector_xyz = VectorXYZ(XComponent=0, YComponent=random, ZComponent=random_2)  # -> Vector, Length
move = Move(Geometry=divide_curve_2.Points, Motion=vector_xyz.Vector)  # -> Geometry, Transform
interpolate_2 = Interpolate(Vertices=move.Geometry, Degree=Slider(3, range=0..10), Periodic=False, KnotStyle=1)  # -> Curve, Length, Domain

division_5 = Division(A=interest, B=2)
division_6 = Division(A=division_5, B=100)

# ----
# Create Twigs
twig_length_cm = Slider(7.4, range=1..10)
panel = Panel("""0
-1""")
cull_index = CullIndex(List=move.Geometry, Indices=panel, Wrap=True)
list_length_2 = ListLength(List=cull_index)
construct_domain_4 = ConstructDomain(DomainStart=Slider(0, range=0..0.1), DomainEnd=division_6)
subtraction = Subtraction(A=list_length_2, B=1)
range = Range(Domain=construct_domain_4, Steps=subtraction)
move_away_from = MoveAwayFrom(Geometry=cull_index, Emitter=interpolate_2.Curve, Distance=range)  # -> Geometry, Transform
move_away_from_2 = MoveAwayFrom(Geometry=move_away_from.Geometry, Emitter=emitpoint, Distance=range)  # -> Geometry, Transform
line = Line(StartPoint=cull_index, EndPoint=move_away_from_2.Geometry)
clean_tree_3 = CleanTree(RemoveNulls=True, RemoveInvalid=True, RemoveEmpty=False, Tree=line)
length_2 = Length(Curve=clean_tree_3)
divide_curve_3 = DivideCurve(Curve=clean_tree_3, Count=Slider(5, range=0..10), Kinks=False)  # -> Points, Tangents, Parameters
division_7 = Division(A=length_2, B=Slider(10, range=10..100))
construct_domain_5 = ConstructDomain(DomainStart=0, DomainEnd=division_7)
panel_2 = Panel("""0
-1""")
panel_3 = Panel("""0
-1""")
cull_index_2 = CullIndex(List=divide_curve_3.Points, Indices=panel_2, Wrap=True)  # -> simplify(List)
list_length_3 = ListLength(List=cull_index_2)
list_item = ListItem(List=simplify(divide_curve_3.Points), Index=panel_3, Wrap=True)
random_3 = Random(Range=simplify(graft(construct_domain_5)), Number=list_length_3, Seed=month)
random_4 = Random(Range=simplify(graft(construct_domain_5)), Number=list_length_3, Seed=day)
first_last = FirstLast(List=list_item)  # -> FirstValue, LastValue
vector_xyz_2 = VectorXYZ(XComponent=0, YComponent=random_3, ZComponent=random_4)  # -> Vector, Length
move_2 = Move(Geometry=cull_index_2, Motion=vector_xyz_2.Vector)  # -> simplify(Geometry), Transform
merge_2 = Merge(Data1=first_last.FirstValue, Data2=move_2.Geometry, Data3=first_last.LastValue)
interpolate_3 = Interpolate(Vertices=merge_2, Degree=Slider(1, range=0..10), Periodic=False, KnotStyle=1)  # -> flatten(Curve), Length, Domain

reverse_list = ReverseList(List=move_away_from_2.Geometry)

# ----
# Display stick length
panel_4 = Panel("0")
stream_filter_2 = StreamFilter(Gate=value_2, Stream0=line_sdl, Stream1=line_sdl_3, Stream2=line_sdl_2, Stream3=interpolate.Curve)
list_item_2 = ListItem(List=move.Geometry, Index="-1", Wrap=True)
list_item_3 = ListItem(List=move.Geometry, Index=panel_4, Wrap=True)
length_3 = Length(Curve=stream_filter_2)
line_2 = Line(StartPoint=list_item_3, EndPoint=list_item_2)
round_to_decimal_place = RoundToDecimalPlace(NumberX=length_3, DecimalPlace="2", RoundType=0)  # -> Rounded, Difference
stream_filter_3 = StreamFilter(Gate=value_2, Stream0=line_2, Stream1=line_2, Stream2=line_2, Stream3=interpolate.Curve)
multiplication = Multiplication(A=round_to_decimal_place.Rounded, B=100)
number_slider_3 = Slider(0.03, range=0..0.1)
unit_z = UnitZ(Factor=number_slider_3)
unit_z_2 = UnitZ(Factor=number_slider_3)
text = Text(multiplication)
move_3 = Move(Geometry=stream_filter_3, Motion=unit_z_2)  # -> Geometry, Transform
project = Project(Geometry=move_3.Geometry, Plane=PlaneXY(0, 0, 0))  # -> Geometry, Transform
extrude = Extrude(Base=project.Geometry, Direction=unit_z)
number_slider_4 = Slider(0.01, range=0..0.1)
unit_z_3 = UnitZ(Factor=number_slider_4)
flip = Flip(Surface=extrude)  # -> Surface, Result
concatenate = Concatenate(FragmentA=text, FragmentB=" cm")
move_4 = Move(Geometry=move_3.Geometry, Motion=unit_z_3)  # -> Geometry, Transform
text_on_surface = TextOnSurface(
    Text=concatenate,
    Font="Sans Bold:no Italic:no",
    Height=number_slider_4,
    Depth=Slider(0.0001, range=0..0.0001),
    BaseLine=move_4.Geometry,
    BaseSurface=flip.Surface)
mesh_brep = MeshBrep(
    Brep=text_on_surface,
    Settings={GridMaxCount=0, GridMinCount=16, JaggedSeams=False, MaxEdgeLength=0, MinEdgeLength=0.0001, MinTolerance=0, Refine=True, RefineAngle=0, RelativeTolerance=0.65, SimplePlanes=True, Tolerance=0})
mesh_join = MeshJoin(Meshes=mesh_brep)

# ----
# Filter Gnarliness
number_slider_5 = Slider(5, range=0..10)
number_slider_6 = Slider(7, range=0..100)
number_slider_7 = Slider(9, range=0..100)
number_slider_8 = Slider(11, range=0..100)
number_slider_9 = Slider(13, range=0..100)
larger_than = LargerThan(FirstNumber=interest, SecondNumber=number_slider_5)  # -> LargerThan, OrEqualTo
smaller_than = SmallerThan(FirstNumber=interest, SecondNumber=number_slider_6)  # -> SmallerThan, OrEqualTo
smaller_than_2 = SmallerThan(FirstNumber=interest, SecondNumber=number_slider_7)  # -> SmallerThan, OrEqualTo
larger_than_2 = LargerThan(FirstNumber=interest, SecondNumber=number_slider_6)  # -> LargerThan, OrEqualTo
smaller_than_3 = SmallerThan(FirstNumber=interest, SecondNumber=number_slider_8)  # -> SmallerThan, OrEqualTo
larger_than_3 = LargerThan(FirstNumber=interest, SecondNumber=number_slider_7)  # -> LargerThan, OrEqualTo
smaller_than_4 = SmallerThan(FirstNumber=interest, SecondNumber=number_slider_9)  # -> SmallerThan, OrEqualTo
larger_than_4 = LargerThan(FirstNumber=interest, SecondNumber=number_slider_8)  # -> LargerThan, OrEqualTo
larger_than_5 = LargerThan(FirstNumber=interest, SecondNumber=number_slider_9)  # -> LargerThan, OrEqualTo
gate_and = GateAnd(A=larger_than.OrEqualTo, B=smaller_than.OrEqualTo)
gate_and_2 = GateAnd(A=larger_than_2.LargerThan, B=smaller_than_2.OrEqualTo)
gate_and_3 = GateAnd(A=larger_than_3.LargerThan, B=smaller_than_3.OrEqualTo)
gate_and_4 = GateAnd(A=larger_than_4.LargerThan, B=smaller_than_4.OrEqualTo)
panel_5 = Panel(gate_and)
panel_6 = Panel(gate_and_2)
panel_7 = Panel(gate_and_3)
panel_8 = Panel(gate_and_4)
panel_9 = Panel(larger_than_5.LargerThan)

# ----
# Suggest Danger Level
panel_10 = Panel("""No stress
Low danger
Keep an eye on it
Watch out
Call the paint shop""")
merge_3 = Merge(Data1=gate_and, Data2=gate_and_2, Data3=gate_and_3, Data4=gate_and_4, Data5=larger_than_5.LargerThan)
cull_pattern = CullPattern(List=panel_10, CullPattern=merge_3)
concatenate_2 = Concatenate(FragmentA="Level of car scratch and damage potential: ", FragmentB=cull_pattern)
panel_11 = Panel(concatenate_2)

# ----
# Node Sizes and Values to Taper
branch_min_thickness = Slider(1, range=1..2)
branch_max_thickness_mm = Slider(3.7, range=2..10)
thickness = GetNumber(branch_max_thickness_mm, AtLeast=1, AtMost=1, Maximum=1.797693135e+308, Minimum=-1.797693135e+308, TreeAccess=False)
division_8 = Division(A=thickness, B=1000)
data = Data(flatten(move.Geometry))
list_length_4 = ListLength(List=data)
data_2 = Data(flatten(first_last.LastValue))
subtraction_2 = Subtraction(A=list_length_4, B=1)
list_length_5 = ListLength(List=data_2)
division_9 = Division(A=division_8, B=Slider(3, range=0..10))
repeat_data = RepeatData(Data=division_9, Length=list_length_5)
entwine = Entwine(Branch00=move.Geometry, Branch01=data_2, FlattenInputs=True)  # -> flatten(Result)

division_10 = Division(A=branch_min_thickness, B=1000)

construct_domain_6 = ConstructDomain(DomainStart=division_10, DomainEnd=division_8)
range_2 = Range(Domain=construct_domain_6, Steps=subtraction_2)
entwine_2 = Entwine(Branch00=range_2, Branch01=repeat_data, FlattenInputs=True)  # -> flatten(Result)

# ----
# SubD Pipe and Mesh
number_slider_10 = Slider(0.1, range=0..1)
join_curves = JoinCurves(Curves=[interpolate_2.Curve, interpolate_3.Curve], Preserve=False)  # -> flatten(Curves)
multipipe = MultiPipe(
    Curves=join_curves,
    NodeSize=entwine_2,
    SizePoints=entwine,
    EndOffset=1,
    StrutSize=1,
    Segment=0,
    KinkAngle=number_slider_10,
    CubeFit=0,
    Caps=Slider(1, range=0..10))
mesh_from_subd = MeshFromSubD(SubD=multipipe, Density=2)
weaverbird_s_join_meshes_and_weld = WeaverbirdsJoinMeshesAndWeld(Mesh=mesh_from_subd, Weld=False)

# ----
# Extract Data
cm3 = Slider(0.5, range=0..1)
mesh_volume = MeshVolume(Mesh=mesh_from_subd)  # -> Volume, Centroid
multiplication_2 = Multiplication(A=mesh_volume.Volume, B=Slider(1000000, range=0..1000000))
multiplication_3 = Multiplication(A=multiplication_2, B=cm3)
round_to_decimal_place_2 = RoundToDecimalPlace(NumberX=multiplication_3, DecimalPlace="2", RoundType=0)  # -> Rounded, Difference
round_to_decimal_place_3 = RoundToDecimalPlace(NumberX=multiplication_2, DecimalPlace="2", RoundType=0)  # -> Rounded, Difference
volume_cm3 = Panel(round_to_decimal_place_3.Rounded)
price = Panel(round_to_decimal_place_2.Rounded)

# ----
# Filter Volume
number_slider_11 = Slider(0, range=0..10)
number_slider_12 = Slider(5, range=0..100)
number_slider_13 = Slider(10, range=0..100)
number_slider_14 = Slider(20, range=0..100)
number_slider_15 = Slider(30, range=0..100)
larger_than_6 = LargerThan(FirstNumber=round_to_decimal_place_3.Rounded, SecondNumber=number_slider_11)  # -> LargerThan, OrEqualTo
smaller_than_5 = SmallerThan(FirstNumber=round_to_decimal_place_3.Rounded, SecondNumber=number_slider_12)  # -> SmallerThan, OrEqualTo
smaller_than_6 = SmallerThan(FirstNumber=round_to_decimal_place_3.Rounded, SecondNumber=number_slider_13)  # -> SmallerThan, OrEqualTo
larger_than_7 = LargerThan(FirstNumber=round_to_decimal_place_3.Rounded, SecondNumber=number_slider_12)  # -> LargerThan, OrEqualTo
smaller_than_7 = SmallerThan(FirstNumber=round_to_decimal_place_3.Rounded, SecondNumber=number_slider_14)  # -> SmallerThan, OrEqualTo
larger_than_8 = LargerThan(FirstNumber=round_to_decimal_place_3.Rounded, SecondNumber=number_slider_13)  # -> LargerThan, OrEqualTo
smaller_than_8 = SmallerThan(FirstNumber=round_to_decimal_place_3.Rounded, SecondNumber=number_slider_15)  # -> SmallerThan, OrEqualTo
larger_than_9 = LargerThan(FirstNumber=round_to_decimal_place_3.Rounded, SecondNumber=number_slider_14)  # -> LargerThan, OrEqualTo
larger_than_10 = LargerThan(FirstNumber=round_to_decimal_place_3.Rounded, SecondNumber=number_slider_15)  # -> LargerThan, OrEqualTo
gate_and_5 = GateAnd(A=larger_than_6.OrEqualTo, B=smaller_than_5.OrEqualTo)
gate_and_6 = GateAnd(A=larger_than_7.LargerThan, B=smaller_than_6.OrEqualTo)
gate_and_7 = GateAnd(A=larger_than_8.LargerThan, B=smaller_than_7.OrEqualTo)
gate_and_8 = GateAnd(A=larger_than_9.LargerThan, B=smaller_than_8.OrEqualTo)
panel_12 = Panel(gate_and_5)
panel_13 = Panel(gate_and_6)
panel_14 = Panel(gate_and_7)
panel_15 = Panel(gate_and_8)
panel_16 = Panel(larger_than_10.LargerThan)

# ----
# Suggest Bred and Color Mesh
panel_17 = Panel("""Yorkies, Chihuahuas, Maltese, Pug, Boston Terrier, French Bulldog, and similiar
Baegles, Scottish Terriers, Minature Schnauzers, and similar
Boxer, Bull Dog, Australian Shepherds, Cocker Spaniels, and similar
Labrador Retrievers, German Shepards, Standard Poodles, Border Collie, and similar
Bernese Mountain Dog, Great Dane, St Bernard, and similar""")
merge_4 = Merge(Data1=gate_and_5, Data2=gate_and_6, Data3=gate_and_7, Data4=gate_and_8, Data5=larger_than_10.LargerThan)
merge_5 = Merge(
    Data1=ColourSwatch(SwatchColor=RGB(187, 0, 255)),
    Data2=ColourSwatch(SwatchColor=RGB(0, 255, 183)),
    Data3=ColourSwatch(SwatchColor=RGB(255, 229, 0)),
    Data4=ColourSwatch(SwatchColor=RGB(255, 162, 0)),
    Data5=ColourSwatch(SwatchColor=RGB(255, 30, 0)))
cull_pattern_2 = CullPattern(List=panel_17, CullPattern=merge_4)
cull_pattern_3 = CullPattern(List=merge_5, CullPattern=merge_4)
concatenate_3 = Concatenate(FragmentA="Ideal for breeds like ", FragmentB=cull_pattern_2)
panel_18 = Panel(concatenate_3)
custom_preview = CustomPreview(Geometry=weaverbird_s_join_meshes_and_weld, Material=cull_pattern_3)

mesh_colours = MeshColours(Mesh=weaverbird_s_join_meshes_and_weld, Colours=cull_pattern_3)

context_bake = ContextBake(Geometry=move_3.Geometry)
context_bake_2 = ContextBake(Geometry=mesh_join)
context_print = ContextPrint(Volume=round_to_decimal_place_3.Rounded)
context_print_2 = ContextPrint(Danger=concatenate_2)
context_bake_3 = ContextBake(Geometry=mesh_colours)
context_print_3 = ContextPrint(Price=round_to_decimal_place_2.Rounded)
context_print_4 = ContextPrint(Text=concatenate_3)
